# Grasshopper definition Roadline.gh (Grasshopper 1.0.7)

centerline_of_the_road = GetGeometry(AtLeast=1, AtMost=1, DeleteInput=False, Filter=1074004029, Prompt="Select cahnti curves")
number_slider = Slider(3, range=0..10)
road_span = GetNumber(AtLeast=1, AtMost=1, Maximum=1.797693135e+308, Minimum=-1.797693135e+308)
lenght_between_white_lines = GetNumber(AtLeast=1, AtMost=1, Maximum=1.797693135e+308, Minimum=-1.797693135e+308)
number_slider_2 = Slider(7.17, range=0..10)
crv = Curve([<curve referenced from the Rhino model> x2])
division = Division(A=road_span, B="2")
dash_pattern = DashPattern(Curve=crv, Pattern=lenght_between_white_lines)  # -> Dashes, Gaps
lc_offset = LC_Offset(curves=crv, distance=division)  # -> offsetinside, offsetoutside
lc_offset_2 = LC_Offset(curves=dash_pattern.Dashes, distance=Slider(0.16, range=0..1))  # -> offsetinside, offsetoutside
loft = Loft(
    Curves=[lc_offset_2.offsetinside, lc_offset_2.offsetoutside],
    Options={Adjust=False, Closed=False, LoftEnds=0, LoftSimp=0, LoftType=0, Rebuild=10, Refit=0.01})
unit_z = UnitZ(Factor=Slider(0.01, range=0..0.01))
loft_2 = Loft(
    Curves=[lc_offset.offsetoutside, lc_offset.offsetinside],
    Options={Adjust=False, Closed=False, LoftEnds=0, LoftSimp=0, LoftType=0, Rebuild=10, Refit=0.01})  # -> flatten(Loft)
runion = RegionUnion(Curves=flatten(loft))
runion_2 = RegionUnion(Curves=loft_2)
boundary = BoundarySurfaces(Edges=runion_2)
move = Move(Geometry=runion, Motion=unit_z)  # -> Geometry, Transform
merge = Merge(Data1=boundary, Data2=move.Geometry)
context_bake = ContextBake(Geometry=merge)

# ==== cluster LC_Offset: Offset a set of Curves and sort them by interior and exterior offsets.

distance = ClusterInput()
offset_value = Number(distance)

# ----
# LC_Offset
curves = ClusterInput()
curves_2 = Curve(curves)

neg = Negative(Value=offset_value)
offset = Offset(Curve=curves_2, Distance=offset_value, Plane=PlaneXY(0, 0, 0), Corners=1)
offset_2 = Offset(Curve=curves_2, Distance=neg, Plane=PlaneXY(0, 0, 0), Corners=1)
area = Area(Geometry=offset)  # -> Area, Centroid
area_2 = Area(Geometry=offset_2)  # -> Area, Centroid
item = ListItem(List=area_2.Area, Index=0, Wrap=True)
merge = Merge(Data1=area.Area, Data2=item)
merge_2 = Merge(Data1=offset, Data2=offset_2)
sort = SortList(Keys=merge, ValuesA=merge_2)  # -> Keys, ValuesA
item_2 = ListItem(List=sort.ValuesA, Index=0, Wrap=True)  # -> Item, Item1
crv_offset_outside = Curve(item_2.Item1)
crv_offset_inside = Curve(item_2.Item)
offsetoutside = ClusterOutput(crv_offset_outside)
offsetinside = ClusterOutput(crv_offset_inside)
