# Grasshopper definition what.gh (Grasshopper 1.0.7)
# plug-ins: Kangaroo2 Components, Bifocals

# ----
# Floor Plane parameters
# Levels parameters
lenght = Slider(20, range=0..1000)
weight = Slider(50, range=0..1000)
º_rotate = Slider(92, range=0..100)
f2f = Slider(3, range=0..100)
nº_floors = Slider(43, range=0..100)

rotate_in_degrees = GetNumber(º_rotate, AtLeast=1, AtMost=1, Maximum=1.797693135e+308, Minimum=-1.797693135e+308)
weight_2 = GetNumber(weight, AtLeast=1, AtMost=1, Maximum=1.797693135e+308, Minimum=-1.797693135e+308)
length = GetNumber(lenght, AtLeast=1, AtMost=1, Maximum=1.797693135e+308, Minimum=-1.797693135e+308, Prompt="Length")
floor2floor = GetNumber(f2f, AtLeast=1, AtMost=1, Maximum=1.797693135e+308, Minimum=-1.797693135e+308)
number_of_floors = GetNumber(nº_floors, AtLeast=1, AtMost=1, Maximum=1.797693135e+308, Minimum=-1.797693135e+308)
pt = Point(<point referenced from the Rhino model>)
image = ImageSampler(Filter="Colour", Interpolate=False, Umax=1, Umin=0, Vmax=1, Vmin=0, Wrap=1)

series = Series(Start=0, Step=floor2floor, Count=number_of_floors)

place_building_here = GetPoint(pt, AtLeast=1, AtMost=1, Realtime=True)

rectangle = Rectangle(Plane=place_building_here, XSize=length, YSize=weight_2, Radius=0)  # -> Rectangle, Length
Z = UnitZ(Factor=series)
bnd = Bounds(Numbers=series)
dom = ConstructDomain(DomainStart=0, DomainEnd=1)
move = Move(Geometry=rectangle.Rectangle, Motion=Z)  # -> Geometry, Transform
remap = RemapNumbers(Value=series, Source=bnd, Target=dom)  # -> Mapped, Clipped
area = Area(Geometry=move.Geometry)  # -> Area, Centroid
graph = GraphMapper(
    remap.Mapped,
    x0=0,
    x1=1,
    y0=0,
    y1=1,
    container_name="Bezier",
    cpx=[0, 0.4336470068, 0.3852428198, 1],
    cpy=[0, 0, 0.9941419363, 1])
multiplication = Multiplication(A=graph, B=rotate_in_degrees)
rotate = Rotate(Geometry=move.Geometry, Angle=degrees(multiplication), Plane=area.Centroid)  # -> Geometry, Transform

bal_offset = Slider(2, range=0..100)
neg = Negative(Value=bal_offset)
offset = OffsetCurve(Curve=rotate.Geometry, Distance=neg, Plane=PlaneXY(0, 0, 0), Corners=1)  # -> flatten(Curve)

number_slider = Slider(0.3, range=0.3..1.5)
Z_2 = UnitZ(Factor=number_slider)
rev = Reverse(Vector=Z_2)
extr = Extrude(Base=rotate.Geometry, Direction=rev)
cap = CapHoles(Brep=extr)

addition = Addition(A=bal_offset, B=0.3)

neg_2 = Negative(Value=".25")
offset_2 = OffsetCurve(Curve=rotate.Geometry, Distance=neg_2, Plane=PlaneXY(0, 0, 0), Corners=1)  # -> flatten(Curve)
bal_crv = Curve(offset_2)
shift = ShiftList(List=bal_crv, Shift="-1", Wrap=False)
Z_3 = UnitZ(Factor=Slider(1.1, range=0..4))
extr_2 = Extrude(Base=shift, Direction=Z_3)

shift_2 = ShiftList(List=series, Shift=1, Wrap=False)
subtraction = Subtraction(A=shift_2, B=series)
subtraction_2 = Subtraction(A=subtraction, B="1")
Z_4 = UnitZ(Factor=subtraction_2)
shift_3 = ShiftList(List=offset, Shift=-1, Wrap=False)
shift_4 = ShiftList(List=Z_4, Shift=-1, Wrap=False)
extr_3 = Extrude(Base=shift_3, Direction=shift_4)

dist_between_columns = Slider(6, range=0..100)
explode = Explode(Curve=offset, Recursive=True)  # -> simplify(Segments), Vertices
len = Length(Curve=explode.Segments)
division = Division(A=len, B=dist_between_columns)
divide = DivideCurve(Curve=explode.Segments, Count=division, Kinks=False)  # -> Points, Tangents, Parameters
pshift = ShiftPaths(Data=simplify(divide.Points), Offset=-1)

duppt = RemoveDuplicatePts(Points=pshift, Tolerance=0.01)
subtraction_3 = Subtraction(A=floor2floor, B=number_slider)
Z_5 = UnitZ(Factor=1)
pline = PolyLine(Vertices=duppt, Closed=invert(False))  # -> simplify(Polyline)
Z_6 = UnitZ(Factor=subtraction_3)
cull_i = CullIndex(List=flatten(pline), Indices="-1", Wrap=True)  # -> graft(List)
explode_2 = Explode(Curve=cull_i, Recursive=True)  # -> simplify(graft(Segments)), Vertices
move_2 = Move(Geometry=explode_2.Segments, Motion=Z_6)  # -> simplify(graft(Geometry)), Transform
trim = TrimTree(Tree=explode_2.Segments, Depth=1)
loft = Loft(
    Curves=[explode_2.Segments, move_2.Geometry],
    Options={Adjust=False, Closed=False, LoftEnds=0, LoftSimp=0, LoftType=3, Rebuild=10, Refit=0.01})
entwine = Entwine(
    Branch00=ColourSwatch(SwatchColor=RGBA(0, 191, 255, 94)),
    Branch01=ColourSwatch(SwatchColor=RGB(0, 0, 0)),
    Branch02=ColourSwatch(SwatchColor=RGB(255, 255, 255)),
    Branch03=ColourSwatch(SwatchColor=RGB(153, 153, 153)),
    Branch04=ColourSwatch(SwatchColor=RGB(0, 0, 0)),
    Branch05=ColourSwatch(SwatchColor=RGBA(0, 127, 191, 76)),
    FlattenInputs=True)

neg_3 = Negative(Value=".30")
offset_3 = OffsetCurve(Curve=offset, Distance=neg_3, Plane=PlaneXY(0, 0, 0), Corners=1)  # -> flatten(Curve)
dist_between_columns_2 = Slider(6, range=0..100)
explode_3 = Explode(Curve=offset_3, Recursive=True)  # -> simplify(Segments), Vertices
len_2 = Length(Curve=explode_3.Segments)
division_2 = Division(A=len_2, B=dist_between_columns_2)
divide_2 = DivideCurve(Curve=explode_3.Segments, Count=division_2, Kinks=False)  # -> Points, Tangents, Parameters
pshift_2 = ShiftPaths(Data=simplify(divide_2.Points), Offset=-1)

relitem = RelativeItem(Tree=pshift_2, Offset="{+1}", WrapPaths=False, WrapItems=False)  # -> ItemA, ItemB
addition_2 = Addition(A=pshift_2, B=Z_6)
ln = Line(StartPoint=pshift_2, EndPoint=addition_2)
flip = FlipMatrix(Data=ln)
ln_2 = Line(StartPoint=relitem.ItemA, EndPoint=relitem.ItemB)
cull_i_2 = CullIndex(List=flip, Indices="-1", Wrap=True)
flip_2 = FlipMatrix(Data=cull_i_2)

pipe = Pipe(Curve=flip_2, Radius=".1", Caps=0)

entwine_2 = Entwine(Branch00=extr_2, Branch01=rotate.Geometry, Branch02=cap, Branch03=pipe, Branch04=offset, FlattenInputs=True)  # -> simplify(Result)
merge = Merge(Data1=extr_2, Data2=rotate.Geometry, Data3=cap, Data4=pipe)
context_bake = ContextBake(Geometry=merge)
preview = CustomPreview(Geometry=entwine_2, Material=entwine)
